# Grasshopper definition TestGen.gh (Grasshopper 1.0.7)
# plug-ins: GCodeGenerator, Kangaroo2 Components

number_slider = Slider(77, range=0..100)
merge = Merge()
rectangle = Rectangle(Plane=PlaneXY(0, 0, 0), XSize=number_slider, YSize=number_slider, Radius=0)  # -> Rectangle, Length
pop2d = Populate2D(Region=rectangle.Rectangle, Count=Slider(12, range=1..100), Seed=1)
pop2d_2 = Populate2D(Region=rectangle.Rectangle, Count=Slider(67, range=1..100), Seed=Slider(22, range=0..100))
number_slider_2 = Slider(0.41, range=0.01..1)
vorgroup = VoronoiGroups(Boundary=rectangle.Rectangle, Generation1=pop2d, Generation2=pop2d_2)  # -> Diagram1, Diagram2
explode = Explode(Curve=rectangle.Rectangle, Recursive=True)  # -> Segments, Vertices
g_code_generator_v001 = GCodeGenerator(Curve=vorgroup.Diagram2, Tolerance=number_slider_2)  # -> Debug, DebugStr, ToolPath, GCode
rep = ReplaceText(Text=g_code_generator_v001.GCode, Find="Z5", Replace="Z20", RecursiveReplace=False)
clx = CurveLine(Curve=vorgroup.Diagram2, Line=graft(explode.Segments))  # -> flatten(Points), Params, Count
dupln = RemoveDuplicateLines(Tolerance=number_slider_2)
cull = CullPattern(List=vorgroup.Diagram2, CullPattern=clx.Points)
panel = Panel(rep)
crv = Curve(cull)
