# Grasshopper definition unnamed.gh (Grasshopper 1.0.7)
# plug-ins: GCodeGenerator

number_slider = Slider(3, range=0..3)
crv = Curve([<curve referenced from the Rhino model> x3])
xy = XYPlane(Origin=Point(0, 0, 0))
python = GhPythonScript(size="100", depth=Slider(3, range=1..10))  # -> out, DebugRect; inputs size: Int32, depth: Int32
# ---------- python: Python ----------
__author__ = "frans"
__version__ = "2020.03.31"

import rhinoscriptsyntax as rs
import Rhino.Geometry as geo
import random


DebugRect = []

if depth > 7:
    depth = 7


class Tile:
    
    #DebugRect.append(geo.Rectangle3d(geo.Plane.WorldXY,geo.Point3d(0,0,0),geo.Point3d(size,size,0)))
    def lowerLeft(self):
        p1 = self.p1
        p2 = self.p2
    
        c = (p1+p2) /2
        return [p1, c]
    
    def lowerRight(self):
        p1 = self.p1
        p2 = self.p2
    
        c = (p1+p2) /2
        return [geo.Point2d(c.X,p1.Y),geo.Point2d(p2.X,c.Y)]
    
    def upperLeft(self):
        p1 = self.p1
        p2 = self.p2
    
        c = (p1+p2) /2
        return [geo.Point2d(p1.X,c.Y),geo.Point2d(c.X,p2.Y)]
    
    def upperRight(self):
        p1 = self.p1
        p2 = self.p2
        
        c = (p1+p2) /2
        return [c,p2]
        
    def centerPoint(self,_point1 ,_point2):
        return (_point1 + _point2) / 2
        

    def GetChildren(self): # return child 
        subDivs = [self.lowerLeft(),self.upperLeft(),self.upperRight(),self.lowerRight()]
        childLevel = self.subdivLevel + 1
        
        if(self.orientation == "A"):
            
            return [Tile(childLevel,subDivs[0][0],subDivs[0][1],"D"),
                    Tile(childLevel,subDivs[1][0],subDivs[1][1],"A"),
                    Tile(childLevel,subDivs[2][0],subDivs[2][1],"A"),
                    Tile(childLevel,subDivs[3][0],subDivs[3][1],"B")]
            
        elif(self.orientation == "B"):
            
            return [Tile(childLevel,subDivs[2][0],subDivs[2][1],"C"),
                    Tile(childLevel,subDivs[1][0],subDivs[1][1],"B"),
                    Tile(childLevel,subDivs[0][0],subDivs[0][1],"B"),
                    Tile(childLevel,subDivs[3][0],subDivs[3][1],"A")]
            
        elif(self.orientation == "C"):
            
            return [Tile(childLevel,subDivs[2][0],subDivs[2][1],"B"),
                    Tile(childLevel,subDivs[3][0],subDivs[3][1],"C"),
                    Tile(childLevel,subDivs[0][0],subDivs[0][1],"C"),
                    Tile(childLevel,subDivs[1][0],subDivs[1][1],"D")]
            
        elif(self.orientation == "D"):
            
            return [Tile(childLevel,subDivs[0][0],subDivs[0][1],"A"),
                    Tile(childLevel,subDivs[3][0],subDivs[3][1],"D"),
                    Tile(childLevel,subDivs[2][0],subDivs[2][1],"D"),
                    Tile(childLevel,subDivs[1][0],subDivs[1][1],"C")]
                    
        else:
            print("ERROR GetChildren")
            
    def SubdivideTile(self):
        self.childTiles = self.GetChildren()
        
    def GetTileLine(self):
        _temp = self.lowerLeft()
        c0 = self.centerPoint(_temp[0],_temp[1])
        
        _temp = self.upperLeft()
        c1 = self.centerPoint(_temp[0],_temp[1])
        
        _temp = self.upperRight()
        c2 = self.centerPoint(_temp[0],_temp[1])
        
        _temp = self.lowerRight()
        c3 = self.centerPoint(_temp[0],_temp[1])
        
        if(self.orientation == "A"):
            return c0,c1,c2,c3
            
        elif(self.orientation == "B"):
            return c2,c1,c0,c3
            
        elif(self.orientation == "C"):
            return c2,c3,c0,c1
            
        elif(self.orientation == "D"):
            return c0,c3,c2,c1
            
        else:
            print("ERROR GetTileLine")
            
            

        
    def __init__(self,level,point1,point2,orientation):
        self.subdivLevel = level
        self.p1 = point1
        self.p2 = point2
        self.childTiles = []
        self.orientation = orientation
        
        if(depth > level):
            if(random.random()*100 >= 0):
                self.SubdivideTile()
    
    def AppendDebugRect(self):
        if(len(self.childTiles) == 0):
            DebugRect.append(geo.Rectangle3d(geo.Plane.WorldXY,geo.Point3d(self.p1.X,self.p1.Y,0),geo.Point3d(self.p2.X,self.p2.Y,0)))
        else:
            for c in self.childTiles:
                c.AppendDebugRect();
                
    def AppendToPolyline(self):
        if(len(self.childTiles) == 0):
            P1,P2,P3,P4 = self.GetTileLine()
            DebugRect.append(P1)
            DebugRect.append(P2)
            DebugRect.append(P3)
            DebugRect.append(P4)
        else:
            for c in self.childTiles:
                c.AppendToPolyline();
                



MasterTile = Tile(1,geo.Point2d(0,0),geo.Point2d(size,size),"D")
#MasterTile.AppendDebugRect()
MasterTile.AppendToPolyline()
# ---------- end python ----------
geo = Geometry(python.DebugRect)
pline = PolyLine(Vertices=python.DebugRect, Closed=False)
panel = Panel(python.DebugRect)
rectangle = Rectangle(Plane=xy, XSize=Slider(290, range=0..1000), YSize=Slider(420, range=0..1000), Radius=0)  # -> Rectangle, Length
panel_2 = Panel(python.out)
fillet = Fillet(Curve=pline, Radius="100")
pt = Point()
g_code_generator_v001 = GCodeGenerator(Curve=fillet, Tolerance=Slider(0.3, range=0.01..2))  # -> Debug, DebugStr, ToolPath, GCode
pline_2 = PolyLine(Closed=False)
panel_3 = Panel(g_code_generator_v001.GCode)
